# Grasshopper definition simple-example.gh (Grasshopper 1.0.8)
# plug-ins: Paramecium

number_slider = Slider(1.63, range=0..10)
number_slider_2 = Slider(14.842, range=0..100)
# ②参照形状を使用する例（負のポアソン比サンプル保管台）
number_slider_3 = Slider(5, range=0..100)
range = Range(Domain=number_slider_2, Steps=expr("x-1", number_slider_3))
# ①ベース形状を使用する例（ナットの面取り）
# （変数の設定、出力形状の選択）
polygon = Polygon(Plane=PlaneXY(0, 0, 0), Radius=3, Segments=6, FilletRadius=0)  # -> Polygon, Length
Z = UnitZ(Factor=Slider(2.5, range=0..10))
series = Series(Start=0, Step=1, Count=number_slider_3)
crossref = CrossReference(ListA=series, ListB=series, CrossMode=1)  # -> ListA, ListB
extr = Extrude(Base=polygon.Polygon, Direction=Z)
int = Integer(crossref.ListA)
int_2 = Integer(crossref.ListB)
item = ListItem(List=range, Index=int, Wrap=True)
item_2 = ListItem(List=range, Index=int_2, Wrap=True)
cap = CapHoles(Brep=extr)
pt = ConstructPoint(XCoordinate=item, YCoordinate=item_2, ZCoordinate=0)
paramprtmdlr = ParametricPartModeler(Geometry=cap, VarNames="d", VarValues=Slider(2.5, range=0..10))  # -> Geometries, FCStdPath, PythonLog
multiplication = Multiplication(A=number_slider, B=Slider(0.504, range=0..1))
brep = Brep(paramprtmdlr.Geometries)
addition = Addition(A=int, B=int_2)
ellipse = Ellipse(Plane=pt, Radius1=number_slider, Radius2=multiplication)  # -> Ellipse, Focus1, Focus2
mod = Modulus(A=addition, B="2")
dispatch = Dispatch(List=ellipse.Ellipse, DispatchPattern=mod)  # -> ListA, ListB
area = Area(Geometry=dispatch.ListA)  # -> Area, Centroid
rotate = Rotate(Geometry=dispatch.ListA, Angle=1.570796327, Plane=area.Centroid)  # -> Geometry, Transform
int_3 = Integer(expr("x-1", number_slider_3))
int_4 = Integer(crossref.ListA)
int_5 = Integer(crossref.ListB)
weave = Weave(Pattern=mod, Stream0=dispatch.ListB, Stream1=rotate.Geometry, NullGaps=False)
equals = Equality(FirstNumber=int_5, SecondNumber="0")  # -> Equality, Inequality
equals_2 = Equality(FirstNumber=int_5, SecondNumber=int_3)  # -> Equality, Inequality
equals_3 = Equality(FirstNumber=int_4, SecondNumber="0")  # -> Equality, Inequality
equals_4 = Equality(FirstNumber=int_4, SecondNumber=int_3)  # -> Equality, Inequality
or = GateOr(A=equals_3.Equality, B=equals_4.Equality, C=equals.Equality, D=equals_2.Equality)
dispatch_2 = Dispatch(List=weave, DispatchPattern=or)  # -> ListA, ListB
rectangle = Rectangle(Plane=PlaneXY(0, 0, 0), XSize=number_slider_2, YSize=number_slider_2, Radius=0)  # -> Rectangle, Length
dam = DataDam(DataB=dispatch_2.ListA, DataA=dispatch_2.ListB, DataC=rectangle.Rectangle, BufferDelay=10000000, BufferMode=0)  # -> DataB, DataA, DataC
rdiff = RegionDifference(CurvesA=rectangle.Rectangle, CurvesB=dispatch_2.ListA)
trim = TrimTree(Tree=rdiff, Depth=1)
merge = Merge(Data1=dispatch_2.ListB, Data2=trim)
crv = Curve(merge)
boundary = BoundarySurfaces(Edges=crv)
Z_2 = UnitZ(Factor=Slider(5.657, range=0..100))
extr_2 = Extrude(Base=boundary, Direction=Z_2)
brep_2 = Brep(extr_2)
paramprtmdlr_2 = ParametricPartModeler(RefereceGeometry=brep_2)  # -> Geometries, FCStdPath, PythonLog
brep_3 = Brep(paramprtmdlr_2.Geometries)
